# Grasshopper definition braidify-experiment.gh (Grasshopper 0.9.76)
# plug-ins: MeshEdit Components, Python Interpreter, Anemone, Human, Kangaroo Components, gHowl, Octopus

# ---- group: Evolution Loop and NEAT configuration
panel = Panel("""SteepenedSigmoid .1

BipolarSigmoid .1

Gaussian .1

Linear .1

Sine .1

Cosine .1

Ramp .1

Spike .1

Step .1

Tangent .1

HyperbolicTangent .1

Modulus .1""")
loop_start = LoopStart(Repeat=0)  # -> port, Counter, Data
rn_octevolearn = RandomNetworkOEL(
    Inputs=Slider(2, range=0..10),
    Outputs=Slider(2, range=0..10),
    Functions=panel,
    Hidden=Slider(1, range=0..10),
    Seed=Slider(4, range=0..100))
neat_octevolearn = BreederOEL(
    Inputs=4,
    Outputs=2,
    Generations=Slider(0, range=0..10),
    Functions=["SteepenedSigmoid .1", "BipolarSigmoid .1", "Gaussian .1", "Linear .1", "Sine .1", "Cosine .1", "Ramp .1", "Spike .1", "Step .1", "Tangent .1", "HyperbolicTangent .1", "Modulus .1"],
    SeedNetworks=loop_start.Data,
    Run=False,
    dialogWindowSpawningOn=False,
    iterParameters_propagates_propagate0_class="Octopus.ghSharpNeatLib.Param_GH_Network, Octopus, Version=1.0.0.0, Culture=neutral, PublicKeyToken=null",
    iterParameters_propagates_propagate0_id="N",
    iterParameters_propagates_propagate0_numTargets=0,
    iterParameters_propagates_propagate1_class="Grasshopper.Kernel.Parameters.Param_Integer, Grasshopper, Version=1.0.0.20, Culture=neutral, PublicKeyToken=dda4f5ec2cd80803",
    iterParameters_propagates_propagate1_id="C",
    iterParameters_propagates_propagate1_numTargets=0,
    iterParameters_receivers_receiver0_class="Grasshopper.Kernel.Parameters.Param_Number, Grasshopper, Version=1.0.0.20, Culture=neutral, PublicKeyToken=dda4f5ec2cd80803",
    iterParameters_receivers_receiver0_id="Obj",
    iterParameters_receivers_receiver0_numTargets=0,
    iterParameters_receivers_receiver1_class="Grasshopper.Kernel.Parameters.Param_Number, Grasshopper, Version=1.0.0.20, Culture=neutral, PublicKeyToken=dda4f5ec2cd80803",
    iterParameters_receivers_receiver1_id="B",
    iterParameters_receivers_receiver1_numTargets=0,
    iterParameters_receivers_receiver2_class="Grasshopper.Kernel.Parameters.Param_GenericObject, Grasshopper, Version=1.0.0.20, Culture=neutral, PublicKeyToken=dda4f5ec2cd80803",
    iterParameters_receivers_receiver2_id="P",
    iterParameters_receivers_receiver2_numTargets=0,
    iterParameters_receivers_receiver3_class="Grasshopper.Kernel.Parameters.Param_Boolean, Grasshopper, Version=1.0.0.20, Culture=neutral, PublicKeyToken=dda4f5ec2cd80803",
    iterParameters_receivers_receiver3_id="Cons",
    iterParameters_receivers_receiver3_numTargets=0,
    iterParameters_receivers_receiver4_class="Grasshopper.Kernel.Parameters.Param_Boolean, Grasshopper, Version=1.0.0.20, Culture=neutral, PublicKeyToken=dda4f5ec2cd80803",
    iterParameters_receivers_receiver4_id="E",
    iterParameters_receivers_receiver4_numTargets=0,
    AutoRebuild_flag=True,
    EvaluationUnits_unit0_description="Evaluate Network Solutions",
    EvaluationUnits_unit0_name="Eval",
    EvaluationUnits_unit0_numControllers=2,
    EvaluationUnits_unit0_numPropagates=2,
    EvaluationUnits_unit0_numReceivers=5,
    EvaluationUnits_unit0_propagate0_id="N",
    EvaluationUnits_unit0_propagate1_id="C",
    EvaluationUnits_unit0_receiver0_id="Obj",
    EvaluationUnits_unit0_receiver1_id="B",
    EvaluationUnits_unit0_receiver2_id="P",
    EvaluationUnits_unit0_receiver3_id="Cons",
    EvaluationUnits_unit0_receiver4_id="E")  # -> EvolvedNetworks, FailedNetworks, Info, SavedNetworks
sn_octevolearn = ShowNetworkOEL(Network=rn_octevolearn)
loop_end = LoopEnd(
    port=loop_start.port,
    Exit=False,
    Data=neat_octevolearn.EvolvedNetworks,
    pausedState=False,
    state="Constant output",
    TimeOutVal=0)

# ---- group: Message reciever
port_to_receive_on = Panel("8051")
ip_to_receive_on_this_computer = Panel("10.13.1.103")
udp = UDPReceiver(Address=ip_to_receive_on_this_computer, Port=port_to_receive_on, Pattern=0)  # -> Info, Data
the_message_coming_from_unity = Panel(udp.Data)
panel_2 = Panel(udp.Info)
json_loader = PythonScript(data=udp.Data)  # -> height, dictValues, dictObject
# ---------- json_loader: Python ----------
import json 

if(bool(data)): 
    j = json.loads(data)
    dictValues = []

    for item in j:
        dictValues.append(j[item])
        
    height = j['height']        
else: 
    height = 5
#if(bool(j)): #Empty dict evaluates to false in python
   #shouldExport = True

#dictObject = j
# ---------- end json_loader ----------
panel_3 = Panel(json_loader.dictObject)
panel_4 = Panel(json_loader.dictValues)

# ----
height = Slider(3, range=0..5)
# Note to data: Braid Vectors needs to be changed depending on the last translate vector after each loop!
# 
# Hardcoded for now...
translate_vector = Panel("""{1, 0, 2}
{0, 0, 2}
{2, 0, 2}""")
braid_vectors = Panel("""{0, 0, 0}
{1, 0, 2}
{1, 0, 4}
{3, 0, 6}""")

# ---- group: Approach 1 for splitting a braid: Creates two symmetric braid ending points that has the same origin
Z = UnitZ(Factor=1)
Y = UnitY(Factor=1)  # -> expr("-x", UnitVector)
Z_2 = UnitZ(Factor=1)
Y_2 = UnitY(Factor=1)
addition = Addition(A=Y, B=Z)
move = Move(Motion=addition)  # -> Geometry, Transform
addition_2 = Addition(A=Y_2, B=Z_2)
move_2 = Move(Motion=Vector(0, 0, 10))  # -> Geometry, Transform

# ---- group: Base point
pt = ConstructPoint(XCoordinate=0, YCoordinate=0, ZCoordinate=0)

# ----
c_script = CSharpScript(list=braid_vectors)  # -> listlength; inputs list: list
# ---------- c_script: C# ----------
    listlength = list.Count - 1;
# ---------- end c_script ----------
Z_3 = UnitZ(Factor=height)
loop_start_2 = LoopStart(Repeat=c_script, Trigger=braid_vectors, Data=Slider(0, range=0..10))  # -> port, Counter, Data

# ---- group: Sub division point
move_3 = Move(Geometry=pt, Motion=Z_3)  # -> Geometry, Transform

# ---- group: Params deciding the braid geometry, e.g radius
number_slider = Slider(0, range=0..1)
number_slider_2 = Slider(1, range=0..1)
number_slider_3 = Slider(1, range=0..1)

# ---- group: Copy point and translate it
index = Number(loop_start_2.Counter)
braid_vector = ListItem(List=braid_vectors, Index=index, Wrap=True)
translate_vector_2 = ListItem(List=translate_vector, Index=index, Wrap=True)
move_4 = Move(Geometry=braid_vector, Motion=translate_vector_2)  # -> Geometry, Transform
ln = Line(StartPoint=braid_vector, EndPoint=move_4.Geometry)

# ---- group: Mesh step 1: Create circle and loft it, based on two points
ln_2 = Line(StartPoint=pt, EndPoint=move_3.Geometry)
eval = EvaluateCurve(Curve=reparameterize(ln_2), Parameter=[number_slider, number_slider_2])  # -> Point, Tangent, Angle
circle = CircleCNR(Center=eval.Point, Normal=ln_2, Radius=number_slider_3)
loft = Loft(Curves=circle, Options={Adjust=False, Closed=False, LoftEnds=0, LoftSimp=0, LoftType=0, Rebuild=10, Refit=0.01})

# ---- group: Params deciding mesh geometry
number_slider_4 = Slider(5, range=0..10)
number_slider_5 = Slider(8, range=0..20)

# ----
pt_2 = Point(move_4.Geometry)

# ---- group: Create mesh from circle that is lofted
eval_2 = EvaluateCurve(Curve=ln, Parameter=[Slider(0, range=0..1), Slider(1, range=0..1)])  # -> Point, Tangent, Angle
circle_2 = CircleCNR(Center=eval_2.Point, Normal=ln, Radius=Slider(0.4, range=0..1))
loft_2 = Loft(Curves=circle_2, Options={Adjust=False, Closed=False, LoftEnds=0, LoftSimp=0, LoftType=0, Rebuild=10, Refit=0.01})
mesh_uv = MeshSurface(Surface=loft_2, UCount=Slider(5, range=0..10), VCount=Slider(8, range=0..20), Overhang=True, Equalize=False)
clean = CombineClean(Meshes=mesh_uv)

# ---- group: Mesh step 2: Create mesh surface based on "circled loft"
mesh_uv_2 = MeshSurface(Surface=loft, UCount=number_slider_4, VCount=number_slider_5, Overhang=True, Equalize=False)
clean_2 = CombineClean(Meshes=mesh_uv_2)

# ---- group: Params determing the "lines" in a braid
params = Slider(8, range=0..100)
number_slider_6 = Slider(0.04, range=0..1)

# ---- group: Weaverbirds "braidifying effect"
faceb = FaceBoundaries(Mesh=clean_2)
weaver = Weaver(polylines=faceb, separation=number_slider_6)  # -> warp_2, weft_2
reb = RebuildCurve(Curve=weaver.warp_2, Count=params, Tangents=False)

# ---- group: Mesh previewer
mesh = Mesh(clean_2)
explode = MeshExplode(Mesh=mesh, Interpolate=False)
checkerboard = Checkerboard(Mesh=mesh)
dispatch = Dispatch(List=explode, DispatchPattern=checkerboard)  # -> ListA, ListB
preview = CustomPreview(Geometry=dispatch.ListA, Shader=ColourSwatch(SwatchColor=RGBA(0, 255, 102, 54)))
preview_2 = CustomPreview(Geometry=dispatch.ListB, Shader=ColourSwatch(SwatchColor=RGBA(255, 255, 255, 52)))

# ----
loop_end_2 = LoopEnd(port=loop_start_2.port, Exit=False, Data=clean, pausedState=False, state="Constant & Record", TimeOutVal=0)

# ---- group: single-line weaverbird previewer
item = ListItem(List=weaver.weft_2, Index=Slider(10, range=0..10), Wrap=True)

# ---- group: Final Weaverbird result previewer
previewlw = CustomPreviewLineweights(Geometry=reb, Shader=ColourSwatch(SwatchColor=RGB(0, 119, 255)), Thickness=Slider(2, range=0..10), Absolute=False)

# ----
panel_5 = Panel(loop_end_2)

# ---- group: Browser
browse = BrowseHistory(Iteration=Slider(0, range=0..4), Data_0=loop_end_2)
panel_6 = Panel(browse)

# ----
final_mesh = Mesh(loop_end_2)
mjoin = MeshJoin(Meshes=flatten(final_mesh))

# ---- group: export and message sender
bake_step = PythonScript(curves=reb)  # -> isObjectBaked; inputs curves: list of Curve
# ---------- bake_step: Python ----------
import Rhino as rc
import scriptcontext as sc 
import rhinoscriptsyntax as rs

sc.doc = rc.RhinoDoc.ActiveDoc

#for item in curves:
    #rs.AddPipe(item, 0, 0.1)

sc.doc = ghdoc

isObjectBaked = True
# ---------- end bake_step ----------
directorypath_with_backslashes_no_spaces = Panel("C:\Users\patri\Desktop\braid-evolution\unity\interactive-braid-evolution\Assets\Geometry\test")  # "DirectoryPath with Backslashes NO SPACES and FileName Minus Extension"
export_step = PythonScript(FileNameToSave=directorypath_with_backslashes_no_spaces, shouldExport=bake_step)  # -> message
# ---------- export_step: Python ----------
import rhinoscriptsyntax
import Rhino

shouldExport = False 

if(shouldExport == True):
    FILE_NAME = FileNameToSave
    
    rhinoscriptsyntax.Command("SelAll")
    rhinoscriptsyntax.Command("-Export " + FILE_NAME + ".obj y=n Enter Enter") #y=n turns off silly Y/Z axis swap! Use no spaces in the file path.
    rhinoscriptsyntax.Command("Delete Enter")
    
    message = True
else :
    message = False
# ---------- end export_step ----------
json_encoder = PythonScript(exportSucess=export_step)  # -> jsonString; inputs exportSucess: Boolean
# ---------- json_encoder: Python ----------
import json 



jsonString = json.dumps({
    'name': 'new_model', 
    'generation':'2', 
    'sucess': exportSucess
})
# ---------- end json_encoder ----------

# ---- group: Export and braidify step
faceb_2 = FaceBoundaries(Mesh=mjoin)
params_2 = Slider(8, range=0..100)
weaver_2 = Weaver(polylines=faceb_2, separation=Slider(0.04, range=0..1))  # -> warp_2, weft_2
reb_2 = RebuildCurve(Curve=weaver_2.warp_2, Count=params_2, Tangents=False)
bake_step_2 = PythonScript(curves=reb_2, toggle=Toggle(False))  # -> isObjectBaked; inputs curves: list of Curve
# ---------- bake_step_2: Python ----------
import Rhino as rc
import scriptcontext as sc 
import rhinoscriptsyntax as rs

sc.doc = rc.RhinoDoc.ActiveDoc

if toggle: 
    for item in curves:
        rs.AddPipe(item, 0, 0.1)

sc.doc = ghdoc

isObjectBaked = True
# ---------- end bake_step_2 ----------

# ---- group: export and message sender / Network configuration
ip_to_send_to = Panel("10.13.1.103")
port_to_send_to = Panel("8050")
udp_2 = UDPSender(Address=ip_to_send_to, Port=port_to_send_to, Pattern=0, Data=json_encoder)
panel_7 = Panel(udp_2)

# ----
directorypath_with_backslashes_no_spaces_2 = Panel("C:\Users\patri\Desktop\braid-evolution\unity\interactive-braid-evolution\Assets\Geometry\test")  # "DirectoryPath with Backslashes NO SPACES and FileName Minus Extension"
export_step_2 = PythonScript(FileNameToSave=directorypath_with_backslashes_no_spaces_2, shouldExport=bake_step_2)  # -> message; same code as export_step

# ==== cluster Weaver
separation = ClusterInput()
polylines = ClusterInput()
polylines_2 = Data(polylines)
separation_2 = Data(separation)
disc = Discontinuity(Curve=reparameterize(polylines_2), Level=1)  # -> Points, Parameters
item = ListItem(List=disc.Points, Index=0, Wrap=True)  # -> Item, Item1, Item2, Item3
center = Average(Input=[item.Item, item.Item1, item.Item2, item.Item3])
pl_3pt = Plane3Pt(PointA=item.Item, PointB=item.Item1, PointC=item.Item3)
average = Average(Input=[item.Item3, item.Item])
average_2 = Average(Input=[item.Item1, item.Item2])
average_3 = Average(Input=[item.Item2, item.Item3])
average_4 = Average(Input=[item.Item, item.Item1])
deplane = DeconstructPlane(Plane=pl_3pt)  # -> Origin, XAxis, YAxis, ZAxis
center_2 = Average(Input=[average_4, center, average, item.Item])
center_3 = Average(Input=[item.Item2, average_2, average_3, center])
amp = Amplitude(Vector=deplane.ZAxis, Amplitude=separation_2)
rev = Reverse(Vector=amp)
move = Move(Geometry=center_2, Motion=rev)  # -> Geometry, Transform
move_2 = Move(Geometry=center_3, Motion=amp)  # -> Geometry, Transform
move_3 = Move(Geometry=center_2, Motion=amp)  # -> Geometry, Transform
move_4 = Move(Geometry=center_3, Motion=rev)  # -> Geometry, Transform
merge = Merge(Data1=average_4, Data2=move.Geometry, Data3=average)
merge_2 = Merge(Data1=average_2, Data2=move_2.Geometry, Data3=average_3)
merge_3 = Merge(Data1=item.Item, Data2=move_3.Geometry, Data3=center, Data4=move_4.Geometry, Data5=item.Item2)
intcrv = Interpolate(Vertices=merge, Degree=3, Periodic=False, KnotStyle=1)  # -> Curve, Length, Domain
intcrv_2 = Interpolate(Vertices=merge_3, Degree=3, Periodic=False, KnotStyle=1)  # -> Curve, Length, Domain
intcrv_3 = Interpolate(Vertices=merge_2, Degree=3, Periodic=False, KnotStyle=1)  # -> Curve, Length, Domain
join = JoinCurves(Curves=flatten(intcrv_2.Curve), Preserve=False)
join_2 = JoinCurves(Curves=flatten([intcrv_3.Curve, intcrv.Curve]), Preserve=False)
weft = Data(join)
warp = Data(join_2)
weft_2 = ClusterOutput(weft)
warp_2 = ClusterOutput(warp)
