# Grasshopper definition multiple-braid-export-processer.gh (Grasshopper 0.9.76)
# plug-ins: Python Interpreter, Anemone, gHowl

# ---- group: Message reciever
ip_to_receive_on_this_computer = Panel("10.13.1.103")
port_to_receive_on = Panel("8051")
udp = UDPReceiver(Address=ip_to_receive_on_this_computer, Port=port_to_receive_on, Pattern=0)  # -> Info, Data
the_message_coming_from_unity = Panel(udp.Data)
panel = Panel(udp.Info)
json_loader = PythonScript(data=udp.Data)  # -> height, dictValues, dictObject
# ---------- json_loader: Python ----------
import json 

if(bool(data)): 
    j = json.loads(data)
    dictValues = []

    for item in j:
        dictValues.append(j[item])
        
    height = j['height']        
else: 
    height = 5
#if(bool(j)): #Empty dict evaluates to false in python
   #shouldExport = True

#dictObject = j
# ---------- end json_loader ----------
panel_2 = Panel(json_loader.dictObject)
panel_3 = Panel(json_loader.dictValues)

# ----
number_slider = Slider(1, range=0..10)
loop_start = LoopStart(Repeat=number_slider, Trigger=number_slider)  # -> port, Counter, Data
loop_start_2 = LoopStart(Repeat=number_slider, Trigger=loop_start.Counter)  # -> port, Counter, Data
addition = Addition(A=loop_start_2.Counter, B=loop_start.Counter)
loop_end = LoopEnd(port=loop_start_2.port, Exit=False, Data=flatten(addition), pausedState=False, state="Last & Record", TimeOutVal=0)  # -> flatten(Data)
loop_end_2 = LoopEnd(port=loop_start.port, Exit=False, Data=loop_end, pausedState=False, state="Constant & Record", TimeOutVal=0)
panel_4 = Panel(loop_end_2)

# ---- group: 1st Anemone Example: Simple addition loop
number_slider_2 = Slider(9, range=0..10)
loop_start_3 = LoopStart(Repeat=number_slider_2, Trigger=number_slider_2, Data=Slider(0, range=0..10))  # -> port, Counter, Data
addition_2 = Addition(A=loop_start_3.Data, B=Slider(1, range=0..10))
loop_end_3 = LoopEnd(port=loop_start_3.port, Exit=False, Data=addition_2, pausedState=False, state="Constant & Record", TimeOutVal=0)
panel_5 = Panel(loop_end_3)

# ----
final_mesh = Mesh(loop_end_2)
mjoin = MeshJoin(Meshes=flatten(final_mesh))
bake_step = PythonScript()  # -> isObjectBaked; inputs curves: list of Curve
# ---------- bake_step: Python ----------
import Rhino as rc
import scriptcontext as sc 
import rhinoscriptsyntax as rs

sc.doc = rc.RhinoDoc.ActiveDoc

for item in curves:
    rs.AddPipe(item, 0, 0.1)

sc.doc = ghdoc

isObjectBaked = True
# ---------- end bake_step ----------
directorypath_with_backslashes_no_spaces = Panel("C:\Users\patri\Desktop\braid-evolution\unity\interactive-braid-evolution\Assets\Geometry\test")  # "DirectoryPath with Backslashes NO SPACES and FileName Minus Extension"
export_step = PythonScript(FileNameToSave=directorypath_with_backslashes_no_spaces, shouldExport=bake_step)  # -> message
# ---------- export_step: Python ----------
import rhinoscriptsyntax
import Rhino

if(shouldExport == True):
    FILE_NAME = FileNameToSave
    
    rhinoscriptsyntax.Command("SelAll")
    rhinoscriptsyntax.Command("-Export " + FILE_NAME + ".obj y=n Enter Enter") #y=n turns off silly Y/Z axis swap! Use no spaces in the file path.
    rhinoscriptsyntax.Command("Delete Enter")
    
    message = True
else :
    message = False
# ---------- end export_step ----------
json_encoder = PythonScript(exportSucess=export_step)  # -> jsonString; inputs exportSucess: Boolean
# ---------- json_encoder: Python ----------
import json 



jsonString = json.dumps({
    'name': 'new_model', 
    'generation':'2', 
    'sucess': exportSucess
})
# ---------- end json_encoder ----------

# ---- group: Network configuration
ip_to_send_to = Panel("10.13.1.103")
port_to_send_to = Panel("8050")
udp_2 = UDPSender(Address=ip_to_send_to, Port=port_to_send_to, Pattern=0, Data=json_encoder)
panel_6 = Panel(udp_2)
